# Dynamo graph Example Views Renumber on Sheet.dyn (Dynamo 1.3.4.6666)

# group: INPUTS
boolean = BoolSelector(true)
family_types = FamilyTypes("Titleblock Grid Location Marker:Location Marker INC Titleblock - CD")

# group: INPUT: Select Sheet
number_slider = DoubleSlider(1, range=0..10 step 1)

# group: OPERATION: Get the sheet
element_types = ElementTypes("ViewSheet")
filterElementClass = Synthetic.Revit.CollectorElementFilter.FilterElementClass(element_types)
byFilters = Synthetic.Revit.Collector.ByFilters(filterElementClass)
toElements = Synthetic.Revit.Collector.ToElements(byFilters)
code_block = CodeBlock(l=toElements, n=number_slider) { l[n]; }

# group: WATCH: List of sheets
name = Element.Name(toElements)
watch = Watch(name)

# group: CONTROL
code_block_2 = CodeBlock { null; }
if_ = If(test=boolean, true=code_block, false=code_block_2)

# group: OPERATION: Get Origin Marker
filterFamilyInstance = Synthetic.Revit.CollectorElementFilter.FilterFamilyInstance(family_types)
id = Element.Id(code_block)
filterElementOwnerViewById = Synthetic.Revit.CollectorElementFilter.FilterElementOwnerViewById(id)
create = List.Create(filterFamilyInstance, filterElementOwnerViewById)
filterLogicalAnd = Synthetic.Revit.CollectorElementFilter.FilterLogicalAnd(create)
byFilters_2 = Synthetic.Revit.Collector.ByFilters(filterLogicalAnd)
toElements_2 = Synthetic.Revit.Collector.ToElements(byFilters_2)

# group: OPERATION: Get Grid Spacing
type = FamilyInstance.Type(toElements_2)
string = StringInput("Grid Size X Direction")
string_2 = StringInput("Grid Size Y Direction")
create_2 = List.Create(string, string_2)
parameterByName = Parameter.ParameterByName(element=type, name=create_2, lacing=CrossProduct)
value = Parameter.Value(parameterByName)
code_block_3 = CodeBlock { 12.0; }
div = value / code_block_3
flatten = Flatten(div)

# group: OPERATION: Locate Origin
location = FamilyInstance.Location(toElements_2)
X = Point.X(location)
Y = Point.Y(location)

# group: OPERATION: Renumber Sheets
code_block_4 = CodeBlock(sheet=if_, gridSize=flatten, ptX=X, ptY=Y) { sheet; gridSize[0]; gridSize[1]; ptX; ptY; }
renumberOnSheet = Synthetic.Revit.View.RenumberOnSheet(code_block_4.sheet, code_block_4.out1, code_block_4.out2, code_block_4.ptX, code_block_4.ptY)

watch_2 = Watch(renumberOnSheet)
number_from_feet_and_inches = LengthFromString(0.0508)
number_from_feet_and_inches_2 = LengthFromString(0.0381)

# group: WATCH: Origin Marker
watch_3 = Watch(toElements_2)

# group: WATCH: Grid Spacing
watch_4 = Watch(flatten)

# group: WATCH: Origin Marker Family Type
watch_5 = Watch(type)

# group: WATCH: Origin Location
watch_6 = Watch(location)
